# Grasshopper definition geomstuff.gh (Grasshopper 1.0.7)
# Copyright: I'll just come fight ya lawyers are tedious
# plug-ins: PollinationHBGH

po_model = POModel(autoSync=False, hbModel="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", path=False)
ghpython_script = GhPythonScript(model=po_model)  # -> out, a
# ---------- ghpython_script: Python ----------
__author__ = "TREVOR"
__version__ = "2023.03.08"

import rhinoscriptsyntax as rs

from ladybug_geometry.geometry3d.polyface import Polyface3D
from ladybug_geometry.geometry3d.face import Face3D
from ladybug_rhino import fromgeometry as fg

from honeybee.face import Face
from honeybee.facetype import face_types

floor_geom = []
for room in _model.rooms:
    for face in room.faces:
        if str(face.type) == 'Floor':
            floor_geom.append(face.geometry)
            
floor_geom = Polyface3D.from_faces(floor_geom, 0.01)

a = []
#for v in floor_geom.vertices:
#    a.append( fg.from_point3d(v) )

vs = []
for seg in floor_geom.naked_edges:
    vs.append(seg.vertices)
    # app vert for vert in
    print(seg.vertices[0], seg.vertices[1])

newvs = []
for seg in vs:
    for point in seg:
        newvs.append(point)
        
newface = Face.from_vertices(identifier='myface',
                             vertices=newvs,
                             type=face_types.floor, 
                             boundary_condition=None)
                             
newface = newface.geometry.remove_colinear_vertices(tolerance=0.01)
#print(newface)
# ---------- end ghpython_script ----------
