# Grasshopper definition geometry_test.gh (Grasshopper 1.0.7)
# Copyright: I'll just come fight ya lawyers are tedious
# plug-ins: PollinationHBGH

po_room = PORoom(port=<geometry referenced from the Rhino model>, hbModel="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")
ghpython_script = GhPythonScript(room=po_room)  # -> out, a
# ---------- ghpython_script: Python ----------
from ladybug_geometry.geometry3d import Point3D
from ladybug_rhino.fromgeometry import from_point3d


faces = [face for face in _room.faces]

myface = faces[4]

a = [from_point3d(pt) for pt in myface.punched_vertices]
# ---------- end ghpython_script ----------
