# Grasshopper definition geomoffset.gh (Grasshopper 1.0.7)
# Copyright: I'll just come fight ya lawyers are tedious

panel = Panel("""0.000000, 0.000000
65.573770, 0.000000
65.573770, 13.114754
0.000000, 13.114754""")
text_split = TextSplit(Text=panel, Separators=",")
list_item = ListItem(List=text_split, Index=0, Wrap=True)  # -> Item, Item1
construct_point = ConstructPoint(XCoordinate=list_item.Item, YCoordinate=list_item.Item1, ZCoordinate=0)

panel_2 = Panel("""131.147541, 65.573770
65.573770, 65.573770
65.573770, 131.147541
131.147541, 131.147541""")
text_split_2 = TextSplit(Text=panel_2, Separators=",")
list_item_2 = ListItem(List=text_split_2, Index=0, Wrap=True)  # -> Item, Item1
construct_point_2 = ConstructPoint(XCoordinate=list_item_2.Item, YCoordinate=list_item_2.Item1, ZCoordinate=0)

panel_3 = Panel("""65.573770, 65.573770
131.147541, 65.573770
131.147541, 131.147541
65.573770, 131.147541""")
text_split_3 = TextSplit(Text=panel_3, Separators=",")
list_item_3 = ListItem(List=text_split_3, Index=0, Wrap=True)  # -> Item, Item1
construct_point_3 = ConstructPoint(XCoordinate=list_item_3.Item, YCoordinate=list_item_3.Item1, ZCoordinate=0)

polyline = PolyLine(Vertices=flatten(construct_point), Closed=True)
polyline_2 = PolyLine(Vertices=flatten(construct_point_3), Closed=True)
polyline_3 = PolyLine(Vertices=flatten(construct_point_2), Closed=True)
