# Grasshopper definition story geometry.gh (Grasshopper 1.0.7)
# Copyright: I'll just come fight ya lawyers are tedious

panel = Panel("""98.360656, 32.786885
98.360656, 0.000000
0.000000, 0.000000
0.000000, 32.786885
196.721311, 32.786885
196.721311, 0.000000""")
panel_2 = Panel("""196.721311, 0.000000
98.360656, 32.786885
98.360656, 0.000000
0.000000, 0.000000
0.000000, 32.786885
196.721311, 32.786885""")
panel_3 = Panel("""196.721311, 0.000000
98.360656, 32.786885
98.360656, 0.000000
0.000000, 0.000000
0.000000, 32.786885
196.721311, 32.786885""")
geometry = Geometry([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])
roomsolid = HBRoomFromSolid(geo=flatten(geometry), conditioned=True)  # -> out, rooms; plug-in component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
text_split = TextSplit(Text=panel_3, Separators=",")
solveadj = HBSolveAdjacency(rooms=flatten(roomsolid.rooms), run=Toggle(True))  # -> out, adj_rooms; plug-in component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
list_item = ListItem(List=text_split, Index=0, Wrap=True)  # -> Item, Item1
construct_point = ConstructPoint(XCoordinate=list_item.Item, YCoordinate=list_item.Item1, ZCoordinate=0)
ghpython_script = GhPythonScript()  # -> Out, A
polyline = PolyLine(Vertices=flatten(construct_point), Closed=False)
panel_4 = Panel("""98.360656, 0.000000
0.000000, 0.000000
0.000000, 32.786885
196.721311, 32.786885
196.721311, 0.000000
98.360656, 0.000000""")
text_split_2 = TextSplit(Text=panel_4, Separators=",")
list_item_2 = ListItem(List=text_split_2, Index=0, Wrap=True)  # -> Item, Item1
construct_point_2 = ConstructPoint(XCoordinate=list_item_2.Item, YCoordinate=list_item_2.Item1, ZCoordinate=0)
list_item_3 = ListItem(List=flatten(construct_point_2), Index=Slider(1, range=0..5), Wrap=True)
polyline_2 = PolyLine(Vertices=flatten(construct_point_2), Closed=False)
