# Grasshopper definition story_geometry.gh (Grasshopper 1.0.7)
# Copyright: I'll just come fight ya lawyers are tedious

panel = Panel("""196.721311, 0.000000
98.360656, 32.786885
98.360656, 0.000000
0.000000, 0.000000
0.000000, 32.786885
196.721311, 32.786885""")
text_split = TextSplit(Text=panel, Separators=",")
list_item = ListItem(List=text_split, Index=0, Wrap=True)  # -> Item, Item1
construct_point = ConstructPoint(XCoordinate=list_item.Item, YCoordinate=list_item.Item1, ZCoordinate=0)
geometry = Geometry([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])
list_item_2 = ListItem(List=flatten(construct_point), Index=0, Wrap=True)
polyline = PolyLine(Vertices=flatten(construct_point), Closed=False)
roomsolid = HBRoomFromSolid(geo=flatten(geometry), conditioned=True)  # -> out, rooms; plug-in component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
solveadj = HBSolveAdjacency(rooms=flatten(roomsolid.rooms), run=Toggle(True))  # -> out, adj_rooms; plug-in component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
ghpython_script = GhPythonScript(rooms=solveadj.adj_rooms)  # -> out, a; inputs rooms: list
# ---------- ghpython_script: Python ----------
from ladybug_geometry.geometry3d.polyface import Polyface3D
from ladybug_geometry.geometry3d.pointvector import Point3D

from honeybee.face import Face

from ladybug_rhino import fromgeometry as fg


floorgeom = []

for room in _rooms:
    for face in room.faces:
        if str(face.type) == 'Floor':
            floorgeom.append(face.geometry)

if len(floorgeom) == 0:
    story_geom = floorgeom[0]
else:
    floor_geom = Polyface3D.from_faces(floorgeom, 0.01)
    vertices = []
    for segment in floor_geom.naked_edges:
        vertices.append(segment.vertices[0])

    story_geom = Face.from_vertices(
        identifier="Level_Floor",
        vertices=vertices)
        
    story_geom.duplicate().remove_colinear_vertices(0.001)
        
    

a = [fg.from_point3d(v) for v in story_geom.geometry.lower_left_counter_clockwise_vertices]
# ---------- end ghpython_script ----------
list_item_3 = ListItem(List=ghpython_script.a, Index=0, Wrap=True)
panel_2 = Panel("""98.360656, 0.000000
0.000000, 0.000000
0.000000, 32.786885
196.721311, 32.786885
196.721311, 0.000000
98.360656, 0.000000""")
text_split_2 = TextSplit(Text=panel_2, Separators=",")
list_item_4 = ListItem(List=text_split_2, Index=0, Wrap=True)  # -> Item, Item1
panel_3 = Panel("""98.360656, 32.786885
98.360656, 0.000000
0.000000, 0.000000
0.000000, 32.786885
196.721311, 32.786885
196.721311, 0.000000""")
panel_4 = Panel("""196.721311, 0.000000
98.360656, 32.786885
98.360656, 0.000000
0.000000, 0.000000
0.000000, 32.786885
196.721311, 32.786885""")
construct_point_2 = ConstructPoint(XCoordinate=list_item_4.Item, YCoordinate=list_item_4.Item1, ZCoordinate=0)
list_item_5 = ListItem(List=flatten(construct_point_2), Index=Slider(0, range=0..5), Wrap=True)
polyline_2 = PolyLine(Vertices=flatten(construct_point_2), Closed=False)
