# Grasshopper definition sample_one.gh (Grasshopper 1.0.7)

rectangle = Rectangle(Plane=PlaneXY(0, 0, 0), XSize="5", YSize="5", Radius=0)  # -> Rectangle, Length
box_rectangle = BoxRectangle(Rectangle=rectangle.Rectangle, Height="5")
roomsolid = HBRoomFromSolid(geo=flatten(box_rectangle), conditioned=True)  # -> out, rooms; plug-in component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
model = HBModel(rooms=flatten(roomsolid.rooms))  # -> out, model; plug-in component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
ghpython_script = GhPythonScript(model=model.model)
# ---------- ghpython_script: Python ----------
__author__ = "TREVOR"
__version__ = "2022.10.04"

import rhinoscriptsyntax as rs

print(_model.properties.doe2)
# ---------- end ghpython_script ----------
