# Grasshopper definition wip_gh_room.gh (Grasshopper 1.0.7)
# Copyright: I'll just come fight ya lawyers are tedious

# I'm keeping all these random ghpy tinker tests in here incase anyone finds useful
geometry = Geometry(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)
roomsolid = HBRoomFromSolid(geo=flatten(geometry), conditioned=True)  # -> out, rooms; plug-in component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
facesbytype = HBFacesByType(hb_objs=roomsolid.rooms)  # -> walls, interior_walls, roofs, ceilings, exterior_floors, interior_floors, air_walls, apertures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; plug-in component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
ghpython_script = GhPythonScript(x=facesbytype.walls)  # -> out, a; inputs x: list
# ---------- ghpython_script: Python ----------
from honeybee.facetype import face_types
import math 
for face in x:
    print face.azimuth
    print face.boundary_condition
# ---------- end ghpython_script ----------
