# Grasshopper definition story_geometry_questions.gh (Grasshopper 1.0.7)
# Copyright: I'll just come fight ya lawyers are tedious

geometry = Geometry([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])
roomsolid = HBRoomFromSolid(geo=flatten(geometry), conditioned=True)  # -> out, rooms; plug-in component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
solveadj = HBSolveAdjacency(rooms=flatten(roomsolid.rooms), run=Toggle(True))  # -> out, adj_rooms; plug-in component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
model = HBModel(rooms=flatten(solveadj.adj_rooms))  # -> out, model; plug-in component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
vizwiref = HBVisualizeWireframe(hb_objs=flatten(model.model))  # -> geo; plug-in component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
ghpython_script = GhPythonScript(model=model.model)  # -> out, a, b
# ---------- ghpython_script: Python ----------
__author__ = "TREVOR"
__version__ = "2023.03.08"

import rhinoscriptsyntax as rs

from ladybug_geometry.geometry3d.polyface import Polyface3D
from ladybug_geometry.geometry3d.face import Face3D
from ladybug_rhino import fromgeometry as fg

from honeybee.face import Face
from honeybee.facetype import face_types

floor_geom = []
for room in _model.rooms:
    for face in room.faces:
        if str(face.type) == 'Floor':
            floor_geom.append(face.geometry)
            
story_geom = Polyface3D.from_faces(floor_geom, 0.01)
a = []
for v in story_geom.vertices:
    a.append( fg.from_point3d(v) )

vs = []
for seg in story_geom.naked_edges:
    vs.append(seg.vertices)
    # app vert for vert in
    #print(seg.vertices[0], seg.vertices[1])

newvs = []
for seg in vs:
    for point in seg:
        newvs.append(point)
        
newface = Face.from_vertices(identifier='myface',
                             vertices=newvs,
                             type=face_types.floor, 
                             boundary_condition=None)
                             
#newface = newface.geometry.remove_colinear_vertices(tolerance=0.01)

b = []
for v in newface.lower_left_counter_clockwise_vertices:
    b.append(fg.from_point3d(v))
# ---------- end ghpython_script ----------

# ---- group: original polyface3d vertices
geometry_2 = Geometry(ghpython_script.a)

# ---- group: face from polyface then removed colinear vertices
# the output I expected was four corners or atleast just the boundary vertices
geometry_3 = Geometry(ghpython_script.b)
